# Grasshopper definition Main_1.gh (Grasshopper 1.0.7)
# Copyright: Co-de-iT
# plug-ins: Urbano, MinimumBoundingBox, Heteroptera, treesloth01, Bifocals, Pufferfish, Kangaroo2 Components, LunchBox, Human

path = FilePath("C:\Users\james\OneDrive\Desktop\Thesis\Term 2\GIS\ArcGIS\shp exports\datasettest2.shp")  # disabled
importshp = ImportShapefileFeatures(ShapefilePath=path, Reproject=True)  # -> Points, Metadata, UTMZone, TranslationVector; disabled
pt = Point(importshp.Points)  # disabled

path_2 = FilePath()  # disabled
path_3 = FilePath()  # disabled
path_4 = FilePath()  # disabled
panel = Panel("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")  # disabled

path_5 = FilePath("C:\Users\james\OneDrive\Desktop\Thesis\Term 2\GIS\ArcGIS\shp exports\ForGH\LAM.shp")  # disabled
importshp_2 = ImportShapefileFeatures(ShapefilePath=path_5, Reproject=True)  # -> Points, Metadata, UTMZone, TranslationVector; disabled

path_6 = FilePath("C:\Users\james\OneDrive\Desktop\Thesis\Term 2\GIS\ArcGIS\GeoJSON\WES.geojson")  # disabled
crv = Curve(<curve referenced from the Rhino model>)
crv_2 = Curve(<curve referenced from the Rhino model>)
path_7 = FilePath("C:\Users\james\OneDrive\Desktop\Thesis\Term 2\GIS\ArcGIS\Wandsworth Typologies\w_overlappingheights_test1.shp")  # disabled
crv_3 = Curve(<curve referenced from the Rhino model>)
panel_2 = Panel(path_6)  # disabled
crv_4 = Curve(<curve referenced from the Rhino model>)
boundary = BoundarySurfaces(Edges=[crv_2, crv])
merge = Merge(Data1=crv, Data2=crv_3, Data3=crv_2)
importshp_3 = ImportShapefileFeatures(ShapefilePath=path_7, Reproject=True)  # -> Points, Metadata, UTMZone, TranslationVector; disabled

# ---- group: GeoJSON to Polyline 1.1
jsonpoly_1_1 = GeoJSONToPolyline11(J=panel)  # -> doc_2, P_2, K_3, V_3; disabled

# ----
crv_5 = Curve(<curve referenced from the Rhino model>)
crv_6 = Curve(<curve referenced from the Rhino model>)
crv_7 = Curve(<curve referenced from the Rhino model>)

path_8 = FilePath("C:\Users\james\OneDrive\Desktop\Thesis\Term 2\GIS\ArcGIS\shp exports\ForGH\MERT.shp")
importshp_4 = ImportShapefileFeatures(ShapefilePath=path_8, Reproject=True)  # -> Points, Metadata, UTMZone, TranslationVector; disabled

number_slider = Slider(0, range=0..1000)  # disabled
panel_3 = Panel(importshp_3.Points)  # disabled
entwine = Entwine(Branch00=crv_6, Branch01=crv_5, Branch02=crv_7, Branch03=merge, Branch04=crv_4, FlattenInputs=True)

panel_4 = Panel("""12
15
11
9
10""")
boundary_2 = BoundarySurfaces(Edges=entwine)
Z = UnitZ(Factor=panel_4)
extr = Extrude(Base=boundary_2, Direction=graft(Z))
height = Data(extr)

debrep = DeconstructBrep(Brep=height)  # -> Faces, Edges, Vertices
meta = Metadata(importshp_3.Metadata)  # disabled

tstat = TreeStatistics(Tree=entwine)  # -> Paths, Length, Count
larger = LargerThan(FirstNumber=tstat.Length, SecondNumber="1")  # -> LargerThan, OrEqualTo
dispatch = Dispatch(List=tstat.Paths, DispatchPattern=larger.LargerThan)  # -> ListA, ListB
split = SplitTree(Data=entwine, Masks=flatten(dispatch.ListA))  # -> Positive, Negative
area = Area(Geometry=split.Positive)  # -> Area, Centroid
sort = SortList(Keys=area.Area, ValuesA=split.Positive)  # -> Keys, reverse(ValuesA)
merge_2 = Merge(Data1=split.Negative, Data2=sort.ValuesA)

previewlw = CustomPreviewLineweights(
    Geometry=debrep.Edges,
    Shader=ColourSwatch(SwatchColor=RGBA(0, 0, 255, 80)),
    Thickness=Slider(1.5, range=0..10),
    Absolute=False)
geo = Geometry()  # disabled
pt_2 = Point(importshp_4.Points)

prune = PruneTree(Minimum=0, Maximum=0)  # disabled

panel_5 = Panel("MEAN_mean")  # disabled

path_9 = FilePath("C:\Users\james\OneDrive\Desktop\Thesis\Term 2\GIS\ArcGIS\shp exports\ForGH\SOUT.shp")
importshp_5 = ImportShapefileFeatures(ShapefilePath=path_9, Reproject=True)  # -> Points, Metadata, UTMZone, TranslationVector; disabled

crv_8 = Curve(<curve referenced from the Rhino model>)
pt_3 = Point(importshp_5.Points)

diagram_polylines = Data(simplify(merge_2))

path_10 = FilePath("C:\Users\james\OneDrive\Desktop\Thesis\Term 2\GIS\ArcGIS\shp exports\ForGH\WAND.shp")
importshp_6 = ImportShapefileFeatures(ShapefilePath=path_10, Reproject=True)  # -> Points, Metadata, UTMZone, TranslationVector; disabled

path_11 = FilePath("C:\Users\james\OneDrive\Desktop\Thesis\Term 2\GIS\ArcGIS\shp exports\ForGH\WES.shp")  # disabled
importshp_7 = ImportShapefileFeatures(ShapefilePath=path_11, Reproject=True)  # -> Points, Metadata, UTMZone, TranslationVector; disabled

boundary_3 = BoundarySurfaces(Edges=diagram_polylines)
area_2 = Area(Geometry=boundary_3)  # -> Area, Centroid
item = ListItem(List=diagram_polylines, Index="0", Wrap=True)
pt_4 = Point(importshp_6.Points)
pt_5 = Point(importshp_7.Points)  # disabled

tstat_2 = TreeStatistics(Tree=diagram_polylines)  # -> Paths, Length, Count
larger_2 = LargerThan(FirstNumber=tstat_2.Length, SecondNumber="1")  # -> LargerThan, OrEqualTo
dispatch_2 = Dispatch(List=tstat_2.Paths, DispatchPattern=larger_2.LargerThan)  # -> ListA, ListB
split_2 = SplitTree(Data=diagram_polylines, Masks=flatten(dispatch_2.ListA))  # -> Positive, Negative

debrep_2 = DeconstructBrep(Brep=boundary_3)  # -> Faces, Edges, Vertices
lng = ListLength(List=debrep_2.Vertices)
vertex_number = Data(lng)
panel_6 = Panel(vertex_number)

area_3 = Area(Geometry=item)  # -> Area, Centroid
division = Division(A=area_2.Area, B=area_3.Area)
ma = MassAddition(Input=division)  # -> Result, PartialResults
void_area = Data(ma.Result)
panel_7 = Panel(void_area)

lng_2 = ListLength(List=diagram_polylines)
larger_3 = LargerThan(FirstNumber=lng_2, SecondNumber="1")  # -> LargerThan, OrEqualTo
void = Data(simplify(larger_3.LargerThan))
panel_8 = Panel(void)

preview = CustomPreview(Geometry=boundary_3, Material=ColourSwatch(SwatchColor=RGBA(0, 0, 255, 42)))

boundary_4 = BoundarySurfaces(Edges=item)
debrep_3 = DeconstructBrep(Brep=boundary_4)  # -> Faces, Edges, Vertices
cir = Circle(Plane=debrep_3.Vertices, Radius=2)
trim = TrimWithRegion(Curve=cir, Region=debrep_3.Faces)  # -> Inside, Outside
crv_9 = Curve(trim.Inside)
path_mapper = PathMapper(crv_9, source="{A;B;C}", target="{A}")
darc = DeconstructArc(Arc=path_mapper)  # -> BasePlane, Radius, Angle
deg = Degrees(Radians=darc.Angle)

pt_6 = Point(debrep_2.Vertices)
preview_2 = CustomPreview(Geometry=pt_6, Material=ColourSwatch(SwatchColor=RGBA(0, 0, 255, 80)))
neg = Negative(Value=Slider(5, range=0..10))

item_2 = ListItem(List=split_2.Positive, Index="0", Wrap=True)

shp_curves = Data(Tree({0}: [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], {1}: [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], {2}: [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], {3}: [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], {4}: [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], {5}: [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]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))  # disabled
curve = Curve(<curve referenced from the Rhino model>)  # disabled
curve_2 = Curve([<curve referenced from the Rhino model> x5])  # disabled

item_3 = ListItem(List=split_2.Negative, Index="0", Wrap=True)

area_4 = Area(Geometry=curve_2)  # -> Area, graft(Centroid); disabled
deconstruct_brep = DeconstructBrep(Brep=curve)  # -> Faces, Edges, Vertices; disabled
list_item = ListItem(List=deconstruct_brep.Edges, Index=0, Wrap=True)  # -> Item, Item1; disabled
project = Project(Geometry=area_4.Centroid, Plane=list_item.Item1)  # -> Geometry, Transform; disabled
project_2 = Project(Geometry=area_4.Centroid, Plane=list_item.Item)  # -> Geometry, Transform; disabled
line = Line(StartPoint=area_4.Centroid, EndPoint=project_2.Geometry)  # disabled
line_2 = Line(StartPoint=area_4.Centroid, EndPoint=project.Geometry)  # disabled
length = Length(Curve=line)  # disabled
length_2 = Length(Curve=line_2)  # disabled
merge_3 = Merge()  # disabled
match = MatchTree()  # disabled

cull_i = CullIndex(List=split_2.Positive, Indices="0", Wrap=True)

panel_9 = Panel("Morph_ind_01")  # disabled
panel_10 = Panel("C:\Users\james\OneDrive\Desktop\Thesis\Term 2\Rhino + Grasshopper\")  # disabled
crv_10 = Curve(Tree({0}: [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], {1}: [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], {2}: [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], {3}: [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], {4}: [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], {5}: [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]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))  # disabled
crv_11 = Curve(Tree({0}: [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], {1}: [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], {2}: [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], {3}: [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], {4}: [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], {5}: [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]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))  # disabled
concat = Concatenate(FragmentA=panel_10, FragmentB=panel_9)  # disabled
panel_11 = Panel("0.99999")  # disabled
panel_12 = Panel(concat)  # disabled
panel_13 = Panel("osm_id; c; 100; 0")  # disabled
number_slider_2 = Slider(3, range=0..5)  # disabled
toggle = BooleanToggle(False)  # disabled
data = Data(Tree({0}: [5.147323132], {1}: [6.904306889], {2}: [5.870810986], {3}: [6.499577999], {4}: [8.857197762], {5}: [5.511067867]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))  # disabled
heights = Data(Tree({0;0}: [5.147323132], {1;0}: [6.904306889], {2;0}: [5.870810986], {3;0}: [6.499577999], {4;0}: [8.857197762], {5;0}: [5.511067867]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))  # disabled
panel_14 = Panel("2")  # disabled

toggle_2 = BooleanToggle(True)  # disabled
meta_2 = Metadata(importshp_2.Metadata)  # disabled
meta_3 = Metadata(importshp_2.Metadata)  # disabled
pline = PolyLine(Vertices=importshp_2.Points, Closed=toggle_2)  # -> simplify(Polyline); disabled
unflatten = UnflattenTree(Tree=meta_3, Guide=pline)  # disabled
demeta = DeconstructMetadata(Metadata=unflatten)  # -> Keys, Values; disabled
panel_15 = Panel("MAX_max")  # disabled
panel_16 = Panel("osm_id")  # disabled
keysearch = KeyValueSearch(Keys=demeta.Keys, Values=demeta.Values, Search=panel_16)  # -> simplify(Result); disabled
shift = ShiftPaths(Data=keysearch, Offset=-1)  # disabled
data_2 = Data(simplify(shift))  # disabled

unflatten_2 = UnflattenTree(Tree=meta_2, Guide=pline)  # disabled
polylines = Data(pline)  # disabled

demeta_2 = DeconstructMetadata(Metadata=unflatten_2)  # -> Keys, Values; disabled
keysearch_2 = KeyValueSearch(Keys=demeta_2.Keys, Values=demeta_2.Values, Search=panel_15)  # -> simplify(Result); disabled
shift_2 = ShiftPaths(Data=keysearch_2, Offset=-1)  # disabled
data_3 = Data(simplify(shift_2))  # disabled
shift_3 = ShiftPaths(Data=polylines, Offset=-1)  # disabled

item_4 = ListItem(List=pline, Index=number_slider, Wrap=True)  # disabled

explode = Explode(Curve=polylines, Recursive=True)  # -> Segments, Vertices; disabled
line_3 = Line(explode.Segments)  # disabled
dupln = RemoveDuplicateLines(Lines=line_3, Tolerance=0.01)  # disabled
join = JoinCurves(Curves=dupln, Preserve=False)  # disabled
polylines_2 = Data(simplify(join))  # disabled

join_2 = JoinCurves(Curves=shift_3, Preserve=False)  # disabled

tstat_3 = TreeStatistics(Tree=join_2)  # -> Paths, Length, Count; disabled
panel_17 = Panel("1")  # disabled
larger_4 = LargerThan(FirstNumber=tstat_3.Length, SecondNumber=panel_17)  # -> LargerThan, OrEqualTo; disabled
dispatch_3 = Dispatch(List=tstat_3.Paths, DispatchPattern=larger_4.LargerThan)  # -> ListA, ListB; disabled
split_3 = SplitTree(Data=join_2, Masks=flatten(dispatch_3.ListA))  # -> Positive, Negative; disabled
area_5 = Area(Geometry=split_3.Positive)  # -> Area, Centroid; disabled
sort_2 = SortList(Keys=area_5.Area, ValuesA=split_3.Positive)  # -> reverse(Keys), reverse(ValuesA); disabled
merge_4 = Merge(Data1=split_3.Negative, Data2=sort_2.ValuesA)  # disabled

panel_18 = Panel("0")  # disabled
panel_19 = Panel("0")  # disabled
item_5 = ListItem(List=data_2, Index=panel_19, Wrap=True)  # disabled
item_6 = ListItem(List=data_3, Index=panel_18, Wrap=True)  # disabled

dispatch_4 = Dispatch(List=merge_4, DispatchPattern=[True, False])  # -> ListA, ListB; disabled

polylines_3 = Data(simplify(merge_4))  # disabled
join_3 = TextJoin(Text=polylines_3, Join=",")  # disabled

panel_20 = Panel("0")  # disabled
item_7 = ListItem(List=polylines_3, Index=panel_20, Wrap=True)  # disabled

osm_id = Data(data_2)  # disabled
height_2 = Data(simplify(data_3))  # disabled
join_4 = TextJoin(Text=height_2, Join=",")  # disabled
join_5 = TextJoin(Text=osm_id, Join=",")  # disabled
item_8 = ListItem(List=osm_id, Index=panel_20, Wrap=True)  # disabled
item_9 = ListItem(List=height_2, Index=panel_20, Wrap=True)  # disabled

panel_21 = Panel(item_8)  # disabled

# ---- group: Area
boundary_5 = BoundarySurfaces(Edges=polylines_3)  # disabled
area_6 = Area(Geometry=boundary_5)  # -> Area, Centroid; disabled

# ----
shp_export = ShapefileExport(path=panel_12, shape_type=number_slider_2, geometry=polylines_3, fields=panel_13, write=toggle)  # -> out; inputs path: tree, shape_type: tree, geometry: tree, fields: tree, records: tree, enc: tree, write: Boolean; disabled
# ---------- shp_export: Python ----------
# -*- coding: utf-8 -*-

# Source code available at https://github.com/hiteca

"""
Export geometry and data to ESRI Shapefile.

    Args:
        path: Path to exported .shp file
        shape_type: pyShp shape type (1 - point, 3 - polyline, 5 - polygon...). See full list at https://github.com/GeospatialPython/pyshp
        geometry: Geometry to export
        fields: List of fields (format - "name|type|length")
        records: Data rows. Each row in own branch
        enc: File encoding. 
                Default - utf-8 
        write: [bool] Connect button or toggle to write file
"""
ghenv.Component.Name = "Shapefile Export"
ghenv.Component.NickName = 'Shp Export'
ghenv.Component.IconDisplayMode = ghenv.Component.IconDisplayMode.icon
ghenv.Component.Category = "Extra"
ghenv.Component.SubCategory = "Hiteca"
try: ghenv.Component.AdditionalHelpFromDocStrings = "2"
except: pass


import sys

import System
import clr
import os
clr.AddReference("Grasshopper")
from Grasshopper.Kernel.Data import GH_Path
from Grasshopper import DataTree

import Grasshopper.Kernel as gh

we = gh.GH_RuntimeMessageLevel.Error
ww = gh.GH_RuntimeMessageLevel.Warning

try:
    import shapefile
except:
    message = "Python module 'pyshp' not found. Please download it and install to Rhino IronPython folder using manual at https://github.com/hiteca/ghshp"
    ghenv.Component.AddRuntimeMessage(we, message)
    message = "https://github.com/hiteca/ghshp#install-pyshp"
    ghenv.Component.AddRuntimeMessage(we, message)

import rhinoscriptsyntax as rs

def list2branch(source_tree,data,item_index,data_path):
    _p = GH_Path(data_path).AppendElement(item_index)
    for i in range(len(data)):
        _data = data[i]
        if type(_data) == list:
            soruce_tree = v2branch(source_tree,_data,i,_p)
        else:
            source_tree.AddRange([_data],GH_Path(_p))
    return source_tree
    

def py_tree(source_tree, reverse=False, default=None):
    if not reverse:
        result = {}
        for i in range(len(source_tree.Branches)):
            d = source_tree.Branches[i]
            p = GH_Path(source_tree.Paths[i])
            
            result[p] = list(d)
        if len(result.keys())==0:
            result[GH_Path(0)] = [default]
    else:
        result = DataTree[System.Object]()
        for p in source_tree.keys():
            d = source_tree[p]
            _d = []
            for j in range(len(d)):
                data = d[j]
                if type(data) == list:
                    result = list2branch(result,data,j,p)
                else:
                    _d.append(data)
            if len(_d) > 0:
                result.AddRange(_d,p)
                
    return result


def repeat_latest(data,length):
    if len(data) > length:
        return data[:length]
    else:
        return data + ([data[-1]] * (length - len(data)))


def graft_tree(t):
    r = {}
    for k,v in t.items():
        for i in range(len(v)):
            r[GH_Path(k).AppendElement(i)] = [v[i]]
    return r
    
    
def longest_list(t_a,t_b):
    r_b = {}
    r_a = {}
    prev_a = t_a.items()[0][1]
    prev_b = t_b.items()[0][1]
    
    if len(t_a) >= len(t_b):
        keys = t_a.keys()
    else:
        keys = t_b.keys()

    keys = sorted(keys, key=lambda x: str(GH_Path(x)))

    for k in keys:
        try:
            branch_a = t_a[k]
            prev_a = t_a[k]
        except:
            branch_a = prev_a
        try:
            branch_b = t_b[k]
            prev_b = t_b[k]
        except:
            branch_b = prev_b
        max_len = max(len(branch_b),len(branch_a))
        if len(branch_b) >= len(branch_a):
            branch_a = repeat_latest(branch_a, len(branch_b))
        else:
            branch_b = repeat_latest(branch_b, len(branch_a))
        r_a[k] = branch_a
        r_b[k] = branch_b
        
    return(r_a,r_b)


shape_types = {
    "point" : [
        1, #POINT
        8, #MULTIPOINT
        11, #POINTZ
        18, #MULTIPOINTZ
        21, #POINTM
        28, #MULTIPOINTM
    ],
    "polyline": [
        3, #POLYLINE
        5, #POLYGON
        13, #POLYLINEZ
        15, #POLYGONZ
        23, #POLYLINEM
        25, #POLYGONM
        31, #MULTIPATCH
    ]
}

def find_type(t):
    for k in shape_types.keys():        
        if t in shape_types[k]:
            return k
            


def list2point(pt):
    if len(pt)==2:
        pt.append(0)
    return rc.Geometry.Point3d(pt[0],pt[1],pt[2])


def write_shapefile(file_path, st, geom, fields, data, enc):
    w = shapefile.Writer(shapeType=st)
    sf_type = find_type(st)

    records_dict = {}
    # create fields
    for f in fields:
        _f = f.split(";")
        if len(_f) == 3:
            f_name, f_type, f_len = _f
            f_len2 = 0
        else:
            f_name, f_type, f_len, f_len2 = _f
        w.field(f_name, f_type, int(f_len), int(f_len2))

    # generate geometry
    for geom_branch in geom:
        parts = []
        if sf_type == "point":
            for point in geom_branch:
                parts.append(list(point))
            parts = [parts]
        else:
            for polyline in geom_branch:
                parts_p = []
                points = rs.CurvePoints(polyline)
                for p in points:
                    parts_p.append(list(p))
                parts.append(parts_p)
        w.poly(parts=parts,shapeType=st)
    
    for record in data:
        # TEMP
        # encode strings to ASCII with ignore
        # to prevent the same exception in pyshp
        r = [r.encode("ascii", 'ignore') if type(r) in [str, unicode] else r for r in record]
        w.record(*r)
    
    try:
        w.save(file_path)
        print("Write successful - %s" % file_path)
    except Exception as e:
        print(isinstance(e,UnicodeEncodeError))
        print("Error with writing %s" % file_path,e)
    

path = py_tree(path)
geometry = py_tree(geometry)
shape_type = py_tree(shape_type)
fields = py_tree(fields)
records = py_tree(records)
enc = py_tree(enc, default="utf-8")

def shift_path(d):
    new_dict = {}
    for k,v in d.items():
        _k = k.CullElement()
        if _k not in new_dict.keys():
            new_dict[_k] = []
        new_dict[_k].append(v)
    return new_dict


def write_many(path, shape_type, geometry, fields, records, enc):
    for k,v in path.items():
        
        _geometry = geometry[k]
        write_shapefile(path[k][0], shape_type[k][0], geometry[k], fields[k], 
                        records[k], enc[k][0])


if write == True:
    _path, geometry = longest_list(path,geometry)
    _path, shape_type = longest_list(path,shape_type)
    _path, fields = longest_list(path,fields)
    _path, records = longest_list(path,records)
    _path, enc = longest_list(path,enc)

    geometry = shift_path(geometry)
    records = shift_path(records)

    write_many(path, shape_type, geometry, fields, records, enc)
# ---------- end shp_export ----------
rec = DataRecorder(shp_export, DataLimit=-10, RecordData=True)  # disabled

toggle_3 = BooleanToggle(True)  # disabled
meta_4 = Metadata(importshp_3.Metadata)  # disabled
pline_2 = PolyLine(Vertices=importshp_3.Points, Closed=toggle_3)  # disabled
panel_22 = Panel("MEAN_mean")  # disabled
panel_23 = Panel("OBJECTID")  # disabled
crv_12 = Curve(simplify(pline_2))  # disabled

unflatten_3 = UnflattenTree(Tree=meta_4, Guide=pline_2)  # disabled
unflatten_4 = UnflattenTree(Tree=meta, Guide=pline_2)  # disabled

demeta_3 = DeconstructMetadata(Metadata=unflatten_3)  # -> Keys, Values; disabled
demeta_4 = DeconstructMetadata(Metadata=unflatten_3)  # -> Keys, Values; disabled
keysearch_3 = KeyValueSearch(Keys=demeta_3.Keys, Values=demeta_3.Values, Search=panel_22)  # -> simplify(Result); disabled
keysearch_4 = KeyValueSearch(Keys=demeta_4.Keys, Values=demeta_4.Values, Search=panel_23)  # -> simplify(Result); disabled
data_4 = Data(simplify(keysearch_3))  # disabled

demeta_5 = DeconstructMetadata(Metadata=unflatten_4)  # -> Keys, Values; disabled
viewer = ParamViewer(crv_12)  # disabled
keysearch_5 = KeyValueSearch(Keys=demeta_5.Keys, Values=demeta_5.Values, Search=panel_5)  # -> simplify(Result); disabled
data_5 = Data(simplify(keysearch_4))  # disabled
shift_4 = ShiftPaths(Data=crv_12, Offset=-1)  # disabled
data_6 = Data(simplify(keysearch_5))  # disabled

area_7 = Area(Geometry=crv_12)  # -> Area, Centroid; disabled
panel_24 = Panel("10")  # disabled
smaller = SmallerThan(FirstNumber=area_7.Area, SecondNumber=panel_24)  # -> SmallerThan, OrEqualTo; disabled
dispatch_5 = Dispatch(List=crv_12, DispatchPattern=smaller.SmallerThan)  # -> ListA, ListB; disabled
dispatch_6 = Dispatch(List=data_4, DispatchPattern=smaller.SmallerThan)  # -> ListA, ListB; disabled
dispatch_7 = Dispatch(List=data_5, DispatchPattern=smaller.SmallerThan)  # -> ListA, ListB; disabled
data_7 = Data(dispatch_6.ListB)  # disabled
crv_13 = Curve(dispatch_5.ListB)  # disabled

boundary_6 = BoundarySurfaces(Edges=shift_4)  # disabled
panel_25 = Panel(shift_4)  # disabled

panel_26 = Panel("2.1")  # disabled
smaller_2 = SmallerThan(FirstNumber=data_7, SecondNumber=panel_26)  # -> SmallerThan, OrEqualTo; disabled
dispatch_8 = Dispatch(List=crv_13, DispatchPattern=smaller_2.SmallerThan)  # -> ListA, ListB; disabled
dispatch_9 = Dispatch(List=dispatch_7.ListB, DispatchPattern=smaller_2.SmallerThan)  # -> ListA, ListB; disabled
dispatch_10 = Dispatch(List=data_7, DispatchPattern=smaller_2.SmallerThan)  # -> ListA, ListB; disabled
data_8 = Data(dispatch_10.ListB)  # disabled
Z_2 = UnitZ(Factor=data_8)  # disabled
crv_14 = Curve(dispatch_8.ListB)  # disabled

mean_height = Data(data_8)  # disabled

area_8 = Area(Geometry=item)  # -> Area, Centroid
explode_2 = Explode(Curve=item, Recursive=True)  # -> Segments, simplify(Vertices)
minbb2d = MinimumBoundingBox2D(Points=explode_2.Vertices, Plane=area_8.Centroid)
explode_3 = Explode(Curve=minbb2d, Recursive=True)  # -> Segments, Vertices
len = Length(Curve=explode_3.Segments)
extremums = MinMax(Number=simplify(len))  # -> Minimum, Maximum

previewlw_2 = CustomPreviewLineweights(Geometry=minbb2d, Shader=ColourSwatch(SwatchColor=RGBA(255, 0, 0, 80)), Thickness=Slider(2, range=0..10), Absolute=False)
end = EndPoints(Curve=explode_3.Segments)  # -> Start, End
aligndim = AlignedDimension(Plane=area_8.Centroid, PointA=end.Start, PointB=end.End, Offset=neg, Text="{0:0.00}", Size=1)

width = Data(simplify(extremums.Minimum))
length_3 = Data(extremums.Maximum)

panel_27 = Panel(width)
panel_28 = Panel(length_3)

arcdim = ArcDimension(Arc=crv_9, Offset=Slider(0.25, range=0..1), Text="{0:0.0}°", Size=Slider(0.659, range=0..1))
vertex_angles = Data(simplify(deg))

larger_5 = LargerThan(FirstNumber=vertex_angles, SecondNumber="90")  # -> LargerThan, OrEqualTo
dispatch_11 = Dispatch(List=vertex_angles, DispatchPattern=larger_5.OrEqualTo)  # -> ListA, ListB
smaller_3 = SmallerThan(FirstNumber=dispatch_11.ListA, SecondNumber="135")  # -> SmallerThan, OrEqualTo
dispatch_12 = Dispatch(List=dispatch_11.ListA, DispatchPattern=smaller_3.OrEqualTo)  # -> ListA, ListB
_90_to_135 = Data(dispatch_12.ListA)
smaller_4 = SmallerThan(FirstNumber=dispatch_12.ListB, SecondNumber="180")  # -> SmallerThan, OrEqualTo

larger_6 = LargerThan(FirstNumber=vertex_angles, SecondNumber="270")  # -> LargerThan, OrEqualTo
dispatch_13 = Dispatch(List=vertex_angles, DispatchPattern=larger_6.OrEqualTo)  # -> ListA, ListB
smaller_5 = SmallerThan(FirstNumber=dispatch_13.ListA, SecondNumber="315")  # -> SmallerThan, OrEqualTo
dispatch_14 = Dispatch(List=dispatch_13.ListA, DispatchPattern=smaller_5.OrEqualTo)  # -> ListA, ListB
panel_29 = Panel("180")
_270_to_315 = Data(dispatch_14.ListA)

smaller_6 = SmallerThan(FirstNumber=vertex_angles, SecondNumber="89.999999")  # -> SmallerThan, OrEqualTo
dispatch_15 = Dispatch(List=vertex_angles, DispatchPattern=smaller_6.SmallerThan)  # -> ListA, ListB
larger_7 = LargerThan(FirstNumber=dispatch_15.ListA, SecondNumber="45")  # -> LargerThan, OrEqualTo
dispatch_16 = Dispatch(List=dispatch_15.ListA, DispatchPattern=larger_7.OrEqualTo)  # -> ListA, ListB
_90_to_45 = Data(dispatch_16.ListA)
_0_to_45 = Data(dispatch_16.ListB)

dom = ConstructDomain(DomainStart="89.999999", DomainEnd="45")
dom_2 = ConstructDomain(DomainStart="0.1", DomainEnd="10")
remap = RemapNumbers(Value=_90_to_45, Source=dom, Target=dom_2)  # -> Mapped, Clipped

dom_3 = ConstructDomain(DomainStart="0", DomainEnd="44.999999")
dom_4 = ConstructDomain(DomainStart="0.1", DomainEnd="10")
remap_2 = RemapNumbers(Value=_0_to_45, Source=dom_3, Target=dom_4)  # -> Mapped, Clipped

dom_5 = ConstructDomain(DomainStart="90", DomainEnd="135")
dom_6 = ConstructDomain(DomainStart="0.1", DomainEnd="10")
remap_3 = RemapNumbers(Value=_90_to_135, Source=dom_5, Target=dom_6)  # -> Mapped, Clipped

dom_7 = ConstructDomain(DomainStart="270.111111", DomainEnd="315")
dom_8 = ConstructDomain(DomainStart="0.1", DomainEnd="10")
remap_4 = RemapNumbers(Value=_270_to_315, Source=dom_7, Target=dom_8)  # -> Mapped, Clipped

extr_2 = Extrude(Base=crv_14, Direction=Z_2)  # disabled
panel_30 = Panel("1")  # disabled
panel_31 = Panel("1")  # disabled

clean = CleanTree(RemoveNulls=True, RemoveInvalid=True, RemoveEmpty=True, Tree=extr_2)  # disabled

cap = CapHoles(Brep=clean)  # disabled

trim_2 = TrimTree(Tree=cap, Depth=1)  # disabled

crv_15 = Curve(item_2)

explode_4 = Explode(Curve=crv_15, Recursive=True)  # -> Segments, Vertices
area_9 = Area(Geometry=crv_15)  # -> Area, Centroid
minbb2d_2 = MinimumBoundingBox2D(Points=explode_4.Vertices, Plane=area_9.Centroid)
boundary_7 = BoundarySurfaces(Edges=minbb2d_2)  # -> simplify(Surfaces)
dim = Dimensions(Surface=boundary_7)  # -> UDimension, VDimension
division_2 = Division(A=dim.UDimension, B="3")
division_3 = Division(A=dim.VDimension, B="3")
quads = QuadPanels(Surface=boundary_7, UDivisions=division_2, VDivisions=division_3)  # -> simplify(Panels)
data_9 = Data(quads)

area_10 = Area(Geometry=data_9)  # -> Area, Centroid
incurve = PointInCurve(Point=area_10.Centroid, Curve=item_2)  # -> Relationship, Point
dispatch_17 = Dispatch(List=area_10.Centroid, DispatchPattern=incurve.Relationship)  # -> ListA, ListB
pt_7 = Point(dispatch_17.ListA)

tstat_4 = TreeStatistics(Tree=trim_2)  # -> Paths, Length, Count; disabled
larger_8 = LargerThan(FirstNumber=tstat_4.Length, SecondNumber=panel_30)  # -> LargerThan, OrEqualTo; disabled
dispatch_18 = Dispatch(List=tstat_4.Paths, DispatchPattern=larger_8.LargerThan)  # -> ListA, ListB; disabled
split_4 = SplitTree(Data=trim_2, Masks=flatten(dispatch_18.ListA))  # -> Positive, Negative; disabled
split_5 = SplitList(List=split_4.Positive, Index=panel_31)  # -> ListA, ListB; disabled
sdiff = SolidDifference(BrepsA=split_5.ListA, BrepsB=split_5.ListB)  # disabled

shift_5 = ShiftPaths(Data=sdiff, Offset=-1)  # disabled

merge_5 = Merge(Data1=split_4.Negative, Data2=shift_5)  # disabled

panel_32 = Panel(merge_5)  # disabled

brep = Brep(merge_5)  # disabled
debrep_4 = DeconstructBrep(Brep=brep)  # -> Faces, Edges, Vertices; disabled
area_11 = Area(Geometry=debrep_4.Faces)  # -> Area, Centroid; disabled
pdecon = Deconstruct(Point=area_11.Centroid)  # -> XComponent, YComponent, ZComponent; disabled
sort_3 = SortList(Keys=pdecon.ZComponent, ValuesA=debrep_4.Faces)  # -> Keys, ValuesA; disabled
item_10 = ListItem(List=sort_3.ValuesA, Index=0, Wrap=True)  # disabled
shift_6 = ShiftPaths(Data=item_10, Offset=-1)  # disabled

footprint_srf = Data(shift_6)  # disabled
join_6 = BrepJoin(Breps=sort_3.ValuesA)  # -> Breps, Closed; disabled
panel_33 = Panel(join_6.Breps)  # disabled
split_6 = SplitTree(Data=shift_6, Masks=flatten(dispatch_18.ListA))  # -> Positive, Negative; disabled
edges = BrepEdges(Brep=shift_6)  # -> Naked, Interior, NonManifold; disabled
join_7 = JoinCurves(Curves=edges.Naked, Preserve=False)  # -> simplify(Curves); disabled
crv_16 = Curve(join_7)  # disabled

# ---- group: No. Of Voids
lng_3 = ListLength(List=split_6.Positive)  # disabled
no_of_voids = Data(lng_3)  # disabled
bool = Boolean(lng_3)  # disabled
panel_34 = Panel(bool)  # disabled

# ---- group: VOLUME
volume = Volume(Geometry=merge_5)  # -> Volume, Centroid; disabled
panel_35 = Panel(volume.Volume)  # disabled

# ---- group: AREA
area_12 = Area(Geometry=footprint_srf)  # -> Area, Centroid; disabled
footprint_area = Data(simplify(area_12.Area))  # disabled
panel_36 = Panel(footprint_area)  # disabled

# ---- group: Perimeter
panel_37 = Panel("0")  # disabled
item_11 = ListItem(List=crv_16, Index=panel_37, Wrap=True)  # disabled
len_2 = Length(Curve=item_11)  # disabled
panel_38 = Panel(len_2)  # disabled

# ----
boundary_8 = BoundarySurfaces(Edges=item_11)  # disabled
area_13 = Area(Geometry=boundary_8)  # -> Area, Centroid; disabled
dedomain = DeconstructDomain(Domain=footprint_area)  # -> Start, End; disabled
panel_39 = Panel("0.0 to 1.0")  # disabled
remap_5 = RemapNumbers(Value=dedomain.End, Source=area_13.Area, Target=panel_39)  # -> Mapped, Clipped; disabled

# ---- group: No. of VERTICES
debrep_5 = DeconstructBrep(Brep=shift_6)  # -> Faces, Edges, Vertices; disabled
pt_8 = Point(debrep_5.Vertices)  # disabled
lng_4 = ListLength(List=pt_8)  # -> simplify(Length); disabled
panel_40 = Panel(lng_4)  # disabled

# ----
smaller_7 = SmallerThan(FirstNumber=remap_5.Mapped, SecondNumber=panel_11)  # -> SmallerThan, OrEqualTo; disabled
panel_41 = Panel(remap_5.Mapped)  # disabled
data_10 = Data(smaller_7.SmallerThan)  # disabled
panel_42 = Panel(smaller_7.SmallerThan)  # disabled

len_3 = Length(Curve=item_7)  # disabled

perimeter = Data(len_3)  # disabled

panel_43 = Panel(perimeter)  # disabled

area_14 = Area(Geometry=item_7)  # -> Area, Centroid; disabled
explode_5 = Explode(Curve=item_7, Recursive=True)  # -> Segments, simplify(Vertices); disabled
minbb2d_3 = MinimumBoundingBox2D(Points=explode_5.Vertices, Plane=area_14.Centroid)  # disabled
explode_6 = Explode(Curve=minbb2d_3, Recursive=True)  # -> Segments, Vertices; disabled
len_4 = Length(Curve=explode_6.Segments)  # disabled
extremums_2 = MinMax(Number=simplify(len_4))  # -> Minimum, Maximum; disabled

width_2 = Data(simplify(extremums_2.Minimum))  # disabled
length_4 = Data(extremums_2.Maximum)  # disabled

panel_44 = Panel(width_2)  # disabled
panel_45 = Panel(length_4)  # disabled

multiplication = Multiplication(A=len_3, B=item_9)  # disabled

wall_area = Data(multiplication)  # disabled
join_8 = TextJoin(Text=wall_area, Join=",")  # disabled

panel_46 = Panel(wall_area)  # disabled

smaller_8 = SmallerThan(FirstNumber=vertex_angles, SecondNumber="269.999999")  # -> SmallerThan, OrEqualTo
dispatch_19 = Dispatch(List=vertex_angles, DispatchPattern=smaller_8.SmallerThan)  # -> ListA, ListB
larger_9 = LargerThan(FirstNumber=dispatch_19.ListA, SecondNumber="225")  # -> LargerThan, OrEqualTo
dispatch_20 = Dispatch(List=dispatch_19.ListA, DispatchPattern=larger_9.OrEqualTo)  # -> ListA, ListB
larger_10 = LargerThan(FirstNumber=dispatch_20.ListB, SecondNumber="180")  # -> LargerThan, OrEqualTo
_225_to_270 = Data(dispatch_20.ListA)

dom_9 = ConstructDomain(DomainStart="225", DomainEnd="269.999999")
dom_10 = ConstructDomain(DomainStart="0.1", DomainEnd="10")
remap_6 = RemapNumbers(Value=_225_to_270, Source=dom_9, Target=dom_10)  # -> Mapped, Clipped

number_slider_3 = Slider(4, range=0..10)  # disabled
panel_47 = Panel("0")  # disabled

panel_48 = Panel("3.5")  # disabled
division_4 = Division(A=height_2, B=panel_48)  # disabled
panel_49 = Panel("1")  # disabled
panel_50 = Panel("0")  # disabled
roundd = RoundToDecimalPlace(NumberX=division_4, DecimalPlace=panel_50, RoundType=panel_49)  # -> Rounded, Difference; disabled

ma_2 = MassAddition(Input=roundd.Rounded)  # -> Result, PartialResults; disabled

av_number_of_floors = Data(ma_2.Result)  # disabled
join_9 = TextJoin(Text=av_number_of_floors, Join=",")  # disabled

panel_51 = Panel(av_number_of_floors)  # disabled

boundary_9 = BoundarySurfaces(Edges=item_7)  # disabled
number_slider_4 = Slider(0.25, range=0..1)  # disabled
number_slider_5 = Slider(0.659, range=0..1)  # disabled
number_slider_6 = Slider(2, range=0..6)  # disabled
panel_52 = Panel("2")  # disabled

debrep_6 = DeconstructBrep(Brep=boundary_9)  # -> Faces, Edges, Vertices; disabled
cir_2 = Circle(Plane=debrep_6.Vertices, Radius=2)  # disabled
trim_3 = TrimWithRegion(Curve=cir_2, Region=debrep_6.Faces)  # -> Inside, Outside; disabled
crv_17 = Curve(trim_3.Inside)  # disabled
path_mapper_2 = PathMapper(crv_17, source="{A;B;C}", target="{A}")  # disabled
darc_2 = DeconstructArc(Arc=path_mapper_2)  # -> BasePlane, Radius, Angle; disabled
deg_2 = Degrees(Radians=darc_2.Angle)  # disabled

vertex_angles_2 = Data(simplify(deg_2))  # disabled
join_10 = TextJoin(Text=vertex_angles_2)  # disabled

panel_53 = Panel("90")  # disabled
larger_11 = LargerThan(FirstNumber=vertex_angles_2, SecondNumber=panel_53)  # -> LargerThan, OrEqualTo; disabled
dispatch_21 = Dispatch(List=vertex_angles_2, DispatchPattern=larger_11.OrEqualTo)  # -> ListA, ListB; disabled
panel_54 = Panel("135")  # disabled
smaller_9 = SmallerThan(FirstNumber=dispatch_21.ListA, SecondNumber=panel_54)  # -> SmallerThan, OrEqualTo; disabled
dispatch_22 = Dispatch(List=dispatch_21.ListA, DispatchPattern=smaller_9.OrEqualTo)  # -> ListA, ListB; disabled
panel_55 = Panel("180")  # disabled
_90_to_135_2 = Data(dispatch_22.ListA)  # disabled
smaller_10 = SmallerThan(FirstNumber=dispatch_22.ListB, SecondNumber=panel_55)  # -> SmallerThan, OrEqualTo; disabled

panel_56 = Panel("270")  # disabled
larger_12 = LargerThan(FirstNumber=vertex_angles_2, SecondNumber=panel_56)  # -> LargerThan, OrEqualTo; disabled
dispatch_23 = Dispatch(List=vertex_angles_2, DispatchPattern=larger_12.OrEqualTo)  # -> ListA, ListB; disabled
panel_57 = Panel("315")  # disabled
smaller_11 = SmallerThan(FirstNumber=dispatch_23.ListA, SecondNumber=panel_57)  # -> SmallerThan, OrEqualTo; disabled
dispatch_24 = Dispatch(List=dispatch_23.ListA, DispatchPattern=smaller_11.OrEqualTo)  # -> ListA, ListB; disabled
panel_58 = Panel("180")  # disabled
_270_to_315_2 = Data(dispatch_24.ListA)  # disabled

panel_59 = Panel("89.999999")  # disabled
smaller_12 = SmallerThan(FirstNumber=vertex_angles_2, SecondNumber=panel_59)  # -> SmallerThan, OrEqualTo; disabled
dispatch_25 = Dispatch(List=vertex_angles_2, DispatchPattern=smaller_12.SmallerThan)  # -> ListA, ListB; disabled
panel_60 = Panel("45")  # disabled
larger_13 = LargerThan(FirstNumber=dispatch_25.ListA, SecondNumber=panel_60)  # -> LargerThan, OrEqualTo; disabled
dispatch_26 = Dispatch(List=dispatch_25.ListA, DispatchPattern=larger_13.OrEqualTo)  # -> ListA, ListB; disabled
_90_to_45_2 = Data(dispatch_26.ListA)  # disabled
_0_to_45_2 = Data(dispatch_26.ListB)  # disabled

panel_61 = Panel("10")  # disabled
panel_62 = Panel("0.1")  # disabled
panel_63 = Panel("89.999999")  # disabled
panel_64 = Panel("45")  # disabled
dom_11 = ConstructDomain(DomainStart=panel_63, DomainEnd=panel_64)  # disabled
dom_12 = ConstructDomain(DomainStart=panel_62, DomainEnd=panel_61)  # disabled
remap_7 = RemapNumbers(Value=_90_to_45_2, Source=dom_11, Target=dom_12)  # -> Mapped, Clipped; disabled

panel_65 = Panel("0.1")  # disabled
panel_66 = Panel("10")  # disabled
panel_67 = Panel("0")  # disabled
panel_68 = Panel("44.999999")  # disabled
dom_13 = ConstructDomain(DomainStart=panel_67, DomainEnd=panel_68)  # disabled
dom_14 = ConstructDomain(DomainStart=panel_65, DomainEnd=panel_66)  # disabled
remap_8 = RemapNumbers(Value=_0_to_45_2, Source=dom_13, Target=dom_14)  # -> Mapped, Clipped; disabled

panel_69 = Panel("10")  # disabled
panel_70 = Panel("0.1")  # disabled
panel_71 = Panel("90")  # disabled
panel_72 = Panel("135")  # disabled
dom_15 = ConstructDomain(DomainStart=panel_71, DomainEnd=panel_72)  # disabled
dom_16 = ConstructDomain(DomainStart=panel_70, DomainEnd=panel_69)  # disabled
remap_9 = RemapNumbers(Value=_90_to_135_2, Source=dom_15, Target=dom_16)  # -> Mapped, Clipped; disabled

panel_73 = Panel("10")  # disabled
panel_74 = Panel("0.1")  # disabled
panel_75 = Panel("270.111111")  # disabled
panel_76 = Panel("315")  # disabled
dom_17 = ConstructDomain(DomainStart=panel_75, DomainEnd=panel_76)  # disabled
dom_18 = ConstructDomain(DomainStart=panel_74, DomainEnd=panel_73)  # disabled
remap_10 = RemapNumbers(Value=_270_to_315_2, Source=dom_17, Target=dom_18)  # -> Mapped, Clipped; disabled

debrep_7 = DeconstructBrep(Brep=boundary_5)  # -> Faces, Edges, Vertices; disabled
lng_5 = ListLength(List=debrep_7.Vertices)  # disabled
path_mapper_3 = PathMapper(lng_5, source="{A;B}", target="{A}")  # disabled

vertex_number_2 = Data(path_mapper_3)  # disabled
ma_3 = MassAddition(Input=vertex_number_2)  # -> Result, PartialResults; disabled
join_11 = TextJoin(Text=vertex_number_2, Join=",")  # disabled

panel_77 = Panel(ma_3.Result)  # disabled

shp_curves_2 = Data(crv_16)  # disabled
buildings_with_voids = Data(data_10)  # disabled
no_of_vertices = Data(lng_4)  # disabled
perimeter_distance = Data(len_2)  # disabled
volume_2 = Data(volume.Volume)  # disabled
footprint_area_2 = Data(footprint_area)  # disabled
compactness = Data(remap_5.Mapped)  # disabled

panel_78 = Panel(compactness)  # disabled

diagram_polylines_2 = Data(simplify(polylines_3))  # disabled

tstat_5 = TreeStatistics(Tree=diagram_polylines_2)  # -> Paths, Length, Count; disabled
panel_79 = Panel("1")  # disabled
larger_14 = LargerThan(FirstNumber=tstat_5.Length, SecondNumber=panel_79)  # -> LargerThan, OrEqualTo; disabled
dispatch_27 = Dispatch(List=tstat_5.Paths, DispatchPattern=larger_14.LargerThan)  # -> ListA, ListB; disabled
split_7 = SplitTree(Data=diagram_polylines_2, Masks=flatten(dispatch_27.ListA))  # -> Positive, Negative; disabled

panel_80 = Panel("0")  # disabled
item_12 = ListItem(List=split_7.Positive, Index=panel_80, Wrap=True)  # disabled

panel_81 = Panel("0")  # disabled
item_13 = ListItem(List=split_7.Negative, Index=panel_81, Wrap=True)  # disabled

panel_82 = Panel("0")  # disabled
cull_i_2 = CullIndex(List=split_7.Positive, Indices=panel_82, Wrap=True)  # disabled

area_15 = Area(Geometry=item_7)  # -> Area, Centroid; disabled

lng_6 = ListLength(List=polylines_3)  # disabled
panel_83 = Panel("1")  # disabled
larger_15 = LargerThan(FirstNumber=lng_6, SecondNumber=panel_83)  # -> LargerThan, OrEqualTo; disabled

void_2 = Data(simplify(larger_15.LargerThan))  # disabled
join_12 = TextJoin(Text=void_2)  # disabled

panel_84 = Panel(void_2)  # disabled

ma_4 = MassAddition(Input=area_6.Area)  # -> Result, PartialResults; disabled

area_16 = Data(simplify(ma_4.Result))  # disabled
join_13 = TextJoin(Text=area_16, Join=",")  # disabled

panel_85 = Panel(area_16)  # disabled

multiplication_2 = Multiplication(A=area_16, B=item_9)  # disabled

ma_5 = MassAddition(Input=multiplication_2)  # -> Result, PartialResults; disabled

volume_3 = Data(multiplication_2)  # disabled
join_14 = TextJoin(Text=volume_3, Join=",")  # disabled

panel_86 = Panel(volume_3)  # disabled

addition = Addition(A=wall_area, B=area_16)  # disabled

# ---- group: Data
envelope_area = Data(addition)  # disabled
join_15 = TextJoin(Text=envelope_area, Join=",")  # disabled

# ----
panel_87 = Panel(envelope_area)  # disabled

division_5 = Division(A=item_9, B=area_16)  # disabled
roundd_2 = RoundToDecimalPlace(NumberX=division_5, DecimalPlace=number_slider_3, RoundType=panel_47)  # -> Rounded, Difference; disabled

ma_6 = MassAddition(Input=roundd_2.Rounded)  # -> Result, PartialResults; disabled

height_area_ratio = Data(ma_6.Result)  # disabled
join_16 = TextJoin(Text=height_area_ratio, Join=",")  # disabled

panel_88 = Panel(height_area_ratio)  # disabled

division_6 = Division(A=area_16, B=area_15.Area)  # disabled
ma_7 = MassAddition(Input=division_6)  # -> Result, PartialResults; disabled

void_area_2 = Data(ma_7.Result)  # disabled
join_17 = TextJoin(Text=void_area_2)  # disabled

panel_89 = Panel(void_area_2)  # disabled

dispatch_28 = Dispatch(List=dispatch_20.ListB, DispatchPattern=larger_10.LargerThan)  # -> ListA, ListB
_315_to_360 = Data(dispatch_14.ListB)
dispatch_29 = Dispatch(List=dispatch_12.ListB, DispatchPattern=smaller_4.SmallerThan)  # -> ListA, ListB

_180_to_225 = Data(dispatch_28.ListA)

dom_19 = ConstructDomain(DomainStart="224.999999", DomainEnd="180.111111")
dom_20 = ConstructDomain(DomainStart="0.1", DomainEnd="10")
remap_11 = RemapNumbers(Value=_180_to_225, Source=dom_19, Target=dom_20)  # -> Mapped, Clipped

dom_21 = ConstructDomain(DomainStart="315.111111", DomainEnd="360")
dom_22 = ConstructDomain(DomainStart="0.1", DomainEnd="10")
remap_12 = RemapNumbers(Value=_315_to_360, Source=dom_21, Target=dom_22)  # -> Mapped, Clipped

dom_23 = ConstructDomain(DomainStart="180", DomainEnd="135.111111")
dom_24 = ConstructDomain(DomainStart="0.1", DomainEnd="10")
remap_13 = RemapNumbers(Value=dispatch_29.ListA, Source=dom_23, Target=dom_24)  # -> Mapped, Clipped

merge_6 = Merge(
    Data1=remap_3.Mapped,
    Data2=remap_13.Mapped,
    Data3=remap.Mapped,
    Data4=remap_2.Mapped,
    Data5=remap_11.Mapped,
    Data6=remap_6.Mapped,
    Data7=remap_12.Mapped,
    Data8=remap_4.Mapped)
roundd_3 = RoundToDecimalPlace(NumberX=merge_6, DecimalPlace=Slider(2, range=0..6), RoundType="2")  # -> Rounded, Difference
ma_8 = MassAddition(Input=roundd_3.Rounded)  # -> Result, PartialResults
vertex_complexity = Data(ma_8.Result)
panel_90 = Panel(vertex_complexity)

crv_18 = Curve(item_3)

explode_7 = Explode(Curve=crv_18, Recursive=True)  # -> Segments, Vertices
area_17 = Area(Geometry=crv_18)  # -> Area, Centroid
minbb2d_4 = MinimumBoundingBox2D(Points=explode_7.Vertices, Plane=area_17.Centroid)
boundary_10 = BoundarySurfaces(Edges=minbb2d_4)  # -> simplify(Surfaces)
dim_2 = Dimensions(Surface=boundary_10)  # -> UDimension, VDimension
division_7 = Division(A=dim_2.UDimension, B="3")
division_8 = Division(A=dim_2.VDimension, B="3")
quads_2 = QuadPanels(Surface=boundary_10, UDivisions=division_7, VDivisions=division_8)  # -> simplify(Panels)
data_11 = Data(quads_2)

area_18 = Area(Geometry=data_11)  # -> Area, Centroid
incurve_2 = PointInCurve(Point=area_18.Centroid, Curve=item_3)  # -> Relationship, Point
dispatch_30 = Dispatch(List=area_18.Centroid, DispatchPattern=incurve_2.Relationship)  # -> ListA, ListB
pt_9 = Point(dispatch_30.ListA)
crv_cp = CurveClosestPoint(Point=pt_9, Curve=split_2.Negative)  # -> Point, Parameter, Distance
lng_7 = ListLength(List=pt_9)
ma_9 = MassAddition(Input=crv_cp.Distance)  # -> Result, PartialResults
division_9 = Division(A=ma_9.Result, B=lng_7)

preview_3 = CustomPreview(Geometry=pt_9, Material=ColourSwatch(SwatchColor=RGBA(0, 0, 255, 80)))
vec2pt = Vector2Pt(PointA=pt_9, PointB=crv_cp.Point, Unitize=False)  # -> Vector, Length
sort_4 = SortList(Keys=vec2pt.Length, ValuesA=vec2pt.Vector)  # -> Keys, ValuesA
vdis = VectorDisplay(Anchor=pt_9, Vector=vec2pt.Vector)

density_no_voids = Data(division_9)

item_14 = ListItem(List=sort_4.ValuesA, Index="0", Wrap=True)

arcdim_2 = ArcDimension(Arc=crv_17, Offset=number_slider_4, Text="{0:0.0}°", Size=number_slider_5)  # disabled
_315_to_360_2 = Data(dispatch_24.ListB)  # disabled
dispatch_31 = Dispatch(List=dispatch_22.ListB, DispatchPattern=smaller_10.SmallerThan)  # -> ListA, ListB; disabled

panel_91 = Panel("360")  # disabled
panel_92 = Panel("315.111111")  # disabled
panel_93 = Panel("10")  # disabled
panel_94 = Panel("0.1")  # disabled
dom_25 = ConstructDomain(DomainStart=panel_92, DomainEnd=panel_91)  # disabled
dom_26 = ConstructDomain(DomainStart=panel_94, DomainEnd=panel_93)  # disabled
remap_14 = RemapNumbers(Value=_315_to_360_2, Source=dom_25, Target=dom_26)  # -> Mapped, Clipped; disabled

panel_95 = Panel("10")  # disabled
panel_96 = Panel("0.1")  # disabled
panel_97 = Panel("180")  # disabled
panel_98 = Panel("135.111111")  # disabled
dom_27 = ConstructDomain(DomainStart=panel_97, DomainEnd=panel_98)  # disabled
dom_28 = ConstructDomain(DomainStart=panel_96, DomainEnd=panel_95)  # disabled
remap_15 = RemapNumbers(Value=dispatch_31.ListA, Source=dom_27, Target=dom_28)  # -> Mapped, Clipped; disabled

crv_19 = Curve(item_12)  # disabled
panel_99 = Panel("0")  # disabled

explode_8 = Explode(Curve=crv_19, Recursive=True)  # -> Segments, Vertices; disabled
area_19 = Area(Geometry=crv_19)  # -> Area, Centroid; disabled
minbb2d_5 = MinimumBoundingBox2D(Points=explode_8.Vertices, Plane=area_19.Centroid)  # disabled
boundary_11 = BoundarySurfaces(Edges=minbb2d_5)  # -> simplify(Surfaces); disabled
dim_3 = Dimensions(Surface=boundary_11)  # -> UDimension, VDimension; disabled
panel_100 = Panel("3")  # disabled
division_10 = Division(A=dim_3.UDimension, B=panel_100)  # disabled
division_11 = Division(A=dim_3.VDimension, B=panel_100)  # disabled
quads_3 = QuadPanels(Surface=boundary_11, UDivisions=division_10, VDivisions=division_11)  # -> simplify(Panels); disabled
data_12 = Data(quads_3)  # disabled

area_20 = Area(Geometry=data_12)  # -> Area, Centroid; disabled
incurve_3 = PointInCurve(Point=area_20.Centroid, Curve=item_12)  # -> Relationship, Point; disabled
dispatch_32 = Dispatch(List=area_20.Centroid, DispatchPattern=incurve_3.Relationship)  # -> ListA, ListB; disabled
pt_10 = Point(dispatch_32.ListA)  # disabled

panel_101 = Panel("269.999999")  # disabled
smaller_13 = SmallerThan(FirstNumber=vertex_angles_2, SecondNumber=panel_101)  # -> SmallerThan, OrEqualTo; disabled
dispatch_33 = Dispatch(List=vertex_angles_2, DispatchPattern=smaller_13.SmallerThan)  # -> ListA, ListB; disabled
panel_102 = Panel("225")  # disabled
larger_16 = LargerThan(FirstNumber=dispatch_33.ListA, SecondNumber=panel_102)  # -> LargerThan, OrEqualTo; disabled
dispatch_34 = Dispatch(List=dispatch_33.ListA, DispatchPattern=larger_16.OrEqualTo)  # -> ListA, ListB; disabled
panel_103 = Panel("180")  # disabled
larger_17 = LargerThan(FirstNumber=dispatch_34.ListB, SecondNumber=panel_103)  # -> LargerThan, OrEqualTo; disabled
_225_to_270_2 = Data(dispatch_34.ListA)  # disabled

panel_104 = Panel("225")  # disabled
panel_105 = Panel("269.999999")  # disabled
panel_106 = Panel("10")  # disabled
panel_107 = Panel("0.1")  # disabled
dom_29 = ConstructDomain(DomainStart=panel_104, DomainEnd=panel_105)  # disabled
dom_30 = ConstructDomain(DomainStart=panel_107, DomainEnd=panel_106)  # disabled
remap_16 = RemapNumbers(Value=_225_to_270_2, Source=dom_29, Target=dom_30)  # -> Mapped, Clipped; disabled

graft = GraftTree(Tree=pt_7, IncludeEmptyLists=True, IncludeNullItems=True)

pt_11 = Point(graft)

incurve_4 = PointInCurve(Point=pt_11, Curve=cull_i)  # -> Relationship, Point
ma_10 = MassAddition(Input=incurve_4.Relationship)  # -> Result, PartialResults
dispatch_35 = Dispatch(List=pt_11, DispatchPattern=ma_10.Result)  # -> ListA, ListB
pt_12 = Point(dispatch_35.ListB)
flatten = FlattenTree(Tree=pt_12, Path="{0}")

preview_4 = CustomPreview(Geometry=pt_12, Material=ColourSwatch(SwatchColor=RGBA(0, 0, 255, 80)))

data_13 = Data(split_2.Positive)
crv_cp_2 = CurveClosestPoint(Point=pt_12, Curve=data_13)  # -> Point, Parameter, Distance
flip = FlipMatrix(Data=crv_cp_2.Distance)

vec2pt_2 = Vector2Pt(PointA=pt_12, PointB=crv_cp_2.Point, Unitize=False)  # -> Vector, Length
vec2pt_3 = Vector2Pt(PointA=pt_12, PointB=crv_cp_2.Point, Unitize=False)  # -> Vector, Length
sort_5 = SortList(Keys=vec2pt_2.Length, ValuesA=vec2pt_2.Vector)  # -> Keys, ValuesA
item_15 = ListItem(List=sort_5.ValuesA, Index="0", Wrap=True)
vdis_2 = VectorDisplay(Anchor=pt_12, Vector=item_15)

dispatch_36 = Dispatch(List=dispatch_34.ListB, DispatchPattern=larger_17.LargerThan)  # -> ListA, ListB; disabled

_180_to_225_2 = Data(dispatch_36.ListA)  # disabled

panel_108 = Panel("0.1")  # disabled
panel_109 = Panel("10")  # disabled
panel_110 = Panel("180.111111")  # disabled
panel_111 = Panel("224.999999")  # disabled
dom_31 = ConstructDomain(DomainStart=panel_111, DomainEnd=panel_110)  # disabled
dom_32 = ConstructDomain(DomainStart=panel_108, DomainEnd=panel_109)  # disabled
remap_17 = RemapNumbers(Value=_180_to_225_2, Source=dom_31, Target=dom_32)  # -> Mapped, Clipped; disabled

# ---- group: Envelope Area
debrep_8 = DeconstructBrep(Brep=join_6.Breps)  # -> Faces, Edges, Vertices; disabled
area_21 = Area(Geometry=debrep_8.Faces)  # -> Area, Centroid; disabled

# ----
trim_4 = TrimTree(Tree=area_21.Area, Depth=1)  # disabled

# ---- group: Envelope Area (continued)
ma_11 = MassAddition(Input=trim_4)  # -> Result, PartialResults; disabled
subtraction = Subtraction(A=ma_11.Result, B=area_12.Area)  # disabled
panel_112 = Panel(subtraction)  # disabled

# ---- group: Wall Area
subtraction_2 = Subtraction(A=subtraction, B=area_12.Area)  # disabled
panel_113 = Panel(subtraction_2)  # disabled

# ----
wall_area_2 = Data(subtraction_2)  # disabled
building_envelope_area = Data(subtraction)  # disabled

minbb3d = MinimumBoundingBox3D(Content=sort_3.ValuesA)  # disabled
debox = DeconstructBox(Box=minbb3d)  # -> Plane, X, Y, Z; disabled
merge_7 = Merge(Data1=debox.X, Data2=debox.Y, Data3=debox.Z)  # disabled

trim_5 = TrimTree(Tree=merge_7, Depth=1)  # disabled
panel_114 = Panel(trim_5)  # disabled

dedomain_2 = DeconstructDomain(Domain=trim_5)  # -> Start, End; disabled
subtraction_3 = Subtraction(A=dedomain_2.End, B=dedomain_2.Start)  # disabled
panel_115 = Panel(subtraction_3)  # disabled

# ---- group: MBR Height
panel_116 = Panel("1")  # disabled
item_16 = ListItem(List=subtraction_3, Index=panel_116, Wrap=True)  # disabled
panel_117 = Panel(item_16)  # disabled

# ---- group: MBR Lenegth
panel_118 = Panel("0")  # disabled
item_17 = ListItem(List=subtraction_3, Index=panel_118, Wrap=True)  # disabled
panel_119 = Panel(item_17)  # disabled

# ---- group: MBR Width
panel_120 = Panel("2")  # disabled
item_18 = ListItem(List=subtraction_3, Index=panel_120, Wrap=True)  # disabled
panel_121 = Panel(item_18)  # disabled

# ----
merge_8 = Merge(Data1=item_17, Data2=item_18)  # disabled
extremums_3 = MinMax(Number=merge_8)  # -> Minimum, Maximum; disabled
panel_122 = Panel(extremums_3.Minimum)  # disabled

mbr_length = Data(extremums_3.Maximum)  # disabled
mbr_width = Data(extremums_3.Minimum)  # disabled
mbr_height = Data(item_16)  # disabled

sort_6 = SortList(Keys=crv_cp_2.Distance, ValuesA=crv_cp_2.Distance)  # -> Keys, ValuesA

# ---- group: Vertice Angles
end_2 = EndPoints(Curve=debrep_5.Edges)  # -> Start, End; disabled
ln = Line(StartPoint=end_2.Start, EndPoint=end_2.End)  # disabled
shift_7 = ShiftList(List=ln, Shift=1, Wrap=True)  # disabled
angle = Angle(VectorA=ln, VectorB=shift_7)  # -> Angle, Reflex; disabled
deg_3 = Degrees(Radians=angle.Angle)  # -> simplify(Degrees); disabled

# ----
ma_12 = MassAddition(Input=deg_3)  # -> Result, PartialResults; disabled

vertice_angles = Data(ma_12.Result)  # disabled

# ----
# Perimeter Distance
# Area
# Volume
# No. of Vertices
# Vertice Angles
# Building Envelope Area
# Wall Area
# MBR Height
# MBR Length
# MBR Width
# Building With Voids
# Compactness
merge_9 = Merge(
    Data1=footprint_srf,
    Data2=perimeter_distance,
    Data3=footprint_area_2,
    Data4=volume_2,
    Data5=no_of_vertices,
    Data6=vertice_angles,
    Data7=building_envelope_area,
    Data8=wall_area_2,
    Data9=mbr_height,
    Data10=mbr_length,
    Data11=mbr_width,
    Data12=buildings_with_voids,
    Data13=compactness)  # disabled
panel_123 = Panel(merge_9)  # disabled

# ---- group: Vertice Angles (continued)
panel_124 = Panel(ma_12.Result)  # disabled

# ----
crv_20 = Curve(item_13)  # disabled

explode_9 = Explode(Curve=crv_20, Recursive=True)  # -> Segments, Vertices; disabled
area_22 = Area(Geometry=crv_20)  # -> Area, Centroid; disabled
minbb2d_6 = MinimumBoundingBox2D(Points=explode_9.Vertices, Plane=area_22.Centroid)  # disabled
boundary_12 = BoundarySurfaces(Edges=minbb2d_6)  # -> simplify(Surfaces); disabled
dim_4 = Dimensions(Surface=boundary_12)  # -> UDimension, VDimension; disabled
panel_125 = Panel("3")  # disabled
division_12 = Division(A=dim_4.UDimension, B=panel_125)  # disabled
division_13 = Division(A=dim_4.VDimension, B=panel_125)  # disabled
quads_4 = QuadPanels(Surface=boundary_12, UDivisions=division_12, VDivisions=division_13)  # -> simplify(Panels); disabled
data_14 = Data(quads_4)  # disabled

area_23 = Area(Geometry=data_14)  # -> Area, Centroid; disabled
incurve_5 = PointInCurve(Point=area_23.Centroid, Curve=item_13)  # -> Relationship, Point; disabled
dispatch_37 = Dispatch(List=area_23.Centroid, DispatchPattern=incurve_5.Relationship)  # -> ListA, ListB; disabled
pt_13 = Point(dispatch_37.ListA)  # disabled
crv_cp_3 = CurveClosestPoint(Point=pt_13, Curve=split_7.Negative)  # -> Point, Parameter, Distance; disabled
lng_8 = ListLength(List=pt_13)  # disabled
ma_13 = MassAddition(Input=crv_cp_3.Distance)  # -> Result, PartialResults; disabled
division_14 = Division(A=ma_13.Result, B=lng_8)  # disabled

density_no_voids_2 = Data(division_14)  # disabled

item_19 = ListItem(List=sort_6.ValuesA, Index="0", Wrap=True)

nullrep = ReplaceNulls(Items=item_19, Replacements="0")  # -> Items, Count

path_mapper_4 = PathMapper(nullrep.Items, source="{A;B;C;D}", target="{A}")
path_mapper_5 = PathMapper(pt_12, source="{A;B;C;D}", target="{A}")

ma_14 = MassAddition(Input=path_mapper_4)  # -> Result, PartialResults

lng_9 = ListLength(List=path_mapper_5)
division_15 = Division(A=ma_14.Result, B=lng_9)
density = Data(division_15)

merge_10 = Merge(Data1=density, Data2=density_no_voids)
density_2 = Data(merge_10)
panel_126 = Panel(density_2)

panel_127 = Panel(density)

merge_11 = Merge(
    Data1=remap_9.Mapped,
    Data2=remap_15.Mapped,
    Data3=remap_7.Mapped,
    Data4=remap_8.Mapped,
    Data5=remap_17.Mapped,
    Data6=remap_16.Mapped,
    Data7=remap_14.Mapped,
    Data8=remap_10.Mapped)  # disabled
roundd_4 = RoundToDecimalPlace(NumberX=merge_11, DecimalPlace=number_slider_6, RoundType=panel_52)  # -> Rounded, Difference; disabled
ma_15 = MassAddition(Input=roundd_4.Rounded)  # -> Result, PartialResults; disabled

vertex_complexity_2 = Data(ma_15.Result)  # disabled

panel_128 = Panel(vertex_complexity_2)  # disabled

graft_2 = GraftTree(Tree=pt_10, IncludeEmptyLists=True, IncludeNullItems=True)  # disabled

pt_14 = Point(graft_2)  # disabled

shift_8 = ShiftPaths(Data=pt_14, Offset=-1)  # disabled
incurve_6 = PointInCurve(Point=shift_8, Curve=cull_i_2)  # -> Relationship, Point; disabled

equals = Equality(FirstNumber=incurve_6.Relationship, SecondNumber=panel_14)  # -> Equality, Inequality; disabled

dispatch_38 = Dispatch(List=shift_8, DispatchPattern=equals.Equality)  # -> ListA, ListB; disabled
pt_15 = Point(dispatch_38.ListB)  # disabled
flatten_2 = FlattenTree(Tree=pt_15, Path="{0}")  # disabled

pt_16 = Point(dispatch_38.ListA)  # disabled

data_15 = Data(split_7.Positive)  # disabled
crv_cp_4 = CurveClosestPoint(Point=pt_15, Curve=data_15)  # -> Point, Parameter, Distance; disabled
flip_2 = FlipMatrix(Data=crv_cp_4.Distance)  # disabled
panel_129 = Panel("0")  # disabled

sort_7 = SortList(Keys=crv_cp_4.Distance, ValuesA=crv_cp_4.Distance)  # -> Keys, ValuesA; disabled

path_mapper_6 = PathMapper(sort_7.ValuesA, source="{A;B;C;D}", target="{A}")  # disabled
path_mapper_7 = PathMapper(pt_15, source="{A;B}", target="{A}")  # disabled

item_20 = ListItem(List=sort_7.ValuesA, Index=panel_129, Wrap=True)  # disabled

lng_10 = ListLength(List=path_mapper_7)  # disabled
nullrep_2 = ReplaceNulls(Items=item_20, Replacements=panel_99)  # -> Items, Count; disabled

path_mapper_8 = PathMapper(nullrep_2.Items, source="{A;B}", target="{A}")  # disabled

ma_16 = MassAddition(Input=path_mapper_8)  # -> Result, PartialResults; disabled

division_16 = Division(A=ma_16.Result, B=lng_10)  # disabled
density_3 = Data(division_16)  # disabled

merge_12 = Merge(Data1=density_3, Data2=density_no_voids_2)  # disabled
density_4 = Data(merge_12)  # disabled
panel_130 = Panel(density_4)  # disabled

merge_13 = Merge(
    Data1=join_3,
    Data2=item_9,
    Data3=item_8,
    Data4=join_15,
    Data5=join_8,
    Data6=perimeter,
    Data9=area_16,
    Data10=height_area_ratio,
    Data11=av_number_of_floors,
    Data12=volume_3,
    Data13=ma_3.Result,
    Data14=vertex_complexity_2,
    Data15=void_2,
    Data16=void_area_2,
    Data17=density_4)  # disabled
join_18 = TextJoin(Text=merge_13)  # disabled
split_8 = TextSplit(Text=merge_13, Separators=",")  # disabled
panel_131 = Panel(merge_13)  # disabled

# ==== cluster GeoJSONToPolyline11: Converts GeoJSON into Grasshopper geometry.
J = ClusterInput()
J_2 = Text(J)
rep = ReplaceText(Text=J_2, Find=" ", RecursiveReplace=False)
python = PythonScript(json_string=rep)  # -> doc, polylines, key, value, xyzList, coordList
# ---------- python: Python ----------
doc = """Split featureJSON into features
more exlantion here
HELLO!!!
"""
import json
import rhinoscriptsyntax as rs
import Rhino.Geometry as rg
appendPolyline = []

def main():
    raw_json = json.loads(json_string)
    features_list = raw_json["features"]
    propertieslist = [] 
    valuelist = []
    coordList =[]
    
    for item in features_list:
        coordinates = item['geometry']['coordinates']
        coordList.append(str(coordinates))
        try:#properties
            item['properties']
            properties=item['properties']
            propertieslist.append(properties)
            value = []
            for prop in properties:
                item_value = item['properties'][prop]
                value.append(item_value)
            valuelist.append(value)
        except KeyError: 
            properties = "<null>"
            propertieslist.append(properties)
    return {
            "coordList":coordList,
            "key":propertieslist,
            "value":valuelist,
            }
results = main()
coordList = results["coordList"]
key = results["key"]
value = results["value"]
#colour= results["colour"]
#polylines = results["polylines"]
#brep = results["brep"]
# ---------- end python ----------
python_2 = PythonScript(x=python.key)  # -> simplify(a)
# ---------- python_2: Python ----------
a=x
# ---------- end python_2 ----------
python_3 = PythonScript(x=python.value)  # -> simplify(a); same code as python_2
panel = Panel("""OUTPUTS:

Polyline Curve (P)- Closed Polyline.

Keys (K) - Outputs keys found in properties

Values (V) - Outputs values found in properties""")
panel_2 = Panel(""" 
INPUTS: 

GeoJSON (J) - FeatureCollection containing geoemtry type objects.
*Only accepts easting, northing (N,E) coordinates.
 """)
panel_3 = Panel("For more documentation visit: github.com/madeleinejohanson/Humpback")
lng = ListLength(List=python.coordList)

# ---- group: List of coordinates
data = Data(python.coordList)

# ----
equals = Equality(FirstNumber=lng, SecondNumber=1)  # -> Equality, Inequality
rep_2 = ReplaceText(Text=data, Find=" ", RecursiveReplace=False)
gate = StreamGate(Gate=0)  # -> Target0, Target1
split = TextSplit(Text=rep_2, Separators=",")  # -> simplify(Result)
merge = Merge(
    Data1="GEOJSON TO POLYGON",
    Data2="Converts GeoJSON into Grasshopper geometry.",
    Data3=panel_2,
    Data4=panel,
    Data5=panel_3)
doc = Text(merge)

cull_i = CullIndex(List=split, Indices=0, Wrap=True)
cull_i_2 = CullIndex(List=cull_i, Indices=-1, Wrap=True)

doc_2 = ClusterOutput(doc)
dispatch = Dispatch(List=cull_i_2, DispatchPattern=[False, True])  # -> simplify(ListA), ListB
chars = Characters(Text=dispatch.ListA)  # -> Result, Unicode
mindex = MemberIndex(Set=chars.Result, Member="[")  # -> Index, Count
equals_2 = Equality(FirstNumber=mindex.Count, SecondNumber=2)  # -> simplify(Equality), Inequality
trim = TrimTree(Tree=equals_2.Equality, Depth=1)
ma = MassAddition(Input=trim)  # -> Result, PartialResults
dispatch_2 = Dispatch(List=dispatch.ListA, DispatchPattern=trim)  # -> ListA, ListB
larger = LargerThan(FirstNumber=flatten(ma.Result), SecondNumber=0)  # -> LargerThan, OrEqualTo
viewer = ParamViewer(ma.Result)
index = ItemIndex(List=split, Item=dispatch_2.ListA)  # -> simplify(Index)
clean = CleanTree(RemoveNulls=True, RemoveInvalid=True, RemoveEmpty=True, Tree=index)
short = ShortestList(ListA=Slider(0, range=0..100), ListB=clean, TrimMode=2)  # -> ListA, ListB
dispatch_3 = Dispatch(List=viewer, DispatchPattern=larger.LargerThan)  # -> ListA, ListB
branch = TreeBranch(Tree=split, Path=dispatch_3.ListA, MaintainPaths=True)
branch_2 = TreeBranch(Tree=split, Path=dispatch_3.ListB, MaintainPaths=True)  # -> simplify(Branch)
lng_2 = ListLength(List=branch)
merge_2 = Merge(Data1=short.ListA, Data2=index, Data3=lng_2)
cull_i_3 = CullIndex(List=merge_2, Indices=-1, Wrap=True)
shift = ShiftList(List=merge_2, Shift=1, Wrap=False)
path_mapper = PathMapper(branch_2, source="{A}", target="{A;0}")
subtraction = Subtraction(A=shift, B=cull_i_3)
partition = PartitionList(List=split, Size=subtraction)  # -> simplify(Chunks)
merge_3 = Merge(Data1=path_mapper, Data2=partition)
filter = StreamFilter(Gate=equals.Equality, Stream0=merge_3, Stream1=split)
rep_3 = ReplaceText(Text=filter, Find="[", RecursiveReplace=False)
rep_4 = ReplaceText(Text=rep_3, Find="]", RecursiveReplace=False)
dispatch_4 = Dispatch(List=rep_4, DispatchPattern=[True, False])  # -> ListA, ListB
number_slider = Slider(100000, range=0..100000)
K = Text(simplify(python_2))
V = Data(simplify(python_3))
multiplication = Multiplication(A=dispatch_4.ListB, B=number_slider)
multiplication_2 = Multiplication(A=dispatch_4.ListA, B=number_slider)
pt = ConstructPoint(XCoordinate=multiplication_2, YCoordinate=multiplication, ZCoordinate=0)
lng_3 = ListLength(List=pt)
join = TextJoin(Text=K, Join="█")
join_2 = TextJoin(Text=V, Join="█")
larger_2 = LargerThan(FirstNumber=lng_3, SecondNumber=2)  # -> LargerThan, OrEqualTo
pline = PolyLine(Vertices=pt, Closed=larger_2.LargerThan)
crv = Curve(pline)
P = Curve(simplify(crv))
utrim = UberTrim(data=P, bool=False)
lng_4 = ListLength(List=utrim)
repeat = RepeatData(Data=join, Length=lng_4)
repeat_2 = RepeatData(Data=join_2, Length=lng_4)
split_2 = TextSplit(Text=repeat, Separators="█")  # -> simplify(Result)
split_3 = TextSplit(Text=repeat_2, Separators="█")  # -> simplify(Result)
P_2 = ClusterOutput(P)
K_2 = Text(simplify(split_2))
V_2 = Data(simplify(split_3))
K_3 = ClusterOutput(K_2)
V_3 = ClusterOutput(V_2)

# ==== cluster UberTrim: Better version of Trim
data = ClusterInput()
bool = ClusterInput()
data_2 = Data(data)
trim = TrimTree(Tree=data_2, Depth=1)
null = NullItem(Item=trim)  # -> NullFlags, InvalidFlags, Description
dispatch = Dispatch(List=data_2, DispatchPattern=null.NullFlags)  # -> ListA, ListB
bool_2 = Boolean(bool)
trim_2 = TrimTree(Tree=dispatch.ListB, Depth=1)
bool_3 = Boolean(invert(null.NullFlags))
flatten = FlattenTree(Tree=dispatch.ListA, Path="{0}")
merge = Merge(Data1=flatten, Data2=trim_2)
panel = Panel(null.NullFlags)
trim_3 = TrimTree(Tree=data_2, Depth=bool_3)
bool_4 = Boolean(invert(bool_2))
data_3 = Data(trim_3)
dispatch_2 = Dispatch(List=merge, DispatchPattern=bool_4)  # -> ListA, ListB
dispatch_3 = Dispatch(List=data_3, DispatchPattern=bool_2)  # -> ListA, ListB
clean = CleanTree(RemoveNulls=True, RemoveInvalid=True, RemoveEmpty=True, Tree=dispatch_3.ListB)
clean_2 = CleanTree(RemoveNulls=True, RemoveInvalid=True, RemoveEmpty=True, Tree=dispatch_2.ListB)
merge_2 = Merge(Data1=clean, Data2=clean_2)
R = ClusterOutput(merge_2)
panel_2 = Panel(merge_2)
